# Grasshopper definition 1.gh (Grasshopper 1.0.5)
# plug-ins: Barnacle

value_list = ValueList({"Zero": 0, "One": 1, "Two": 2, "Three": 2² - 1, "Four": Sqrt(16)}, selected="Zero")
point = Point([Point(249, -96, 0), Point(178, -96, 0), Point(178, -31, 0), Point(235, -31, 0)])
list_item = ListItem(List=point, Index=0, Wrap=True)  # -> Item, Item1, Item2, Item3
polyline = PolyLine(Vertices=point, Closed=True)
point_2 = Point(list_item.Item2)
barnacle = Barnacle(PointA=list_item.Item, PointB=list_item.Item1, PointC=list_item.Item2, PointD=list_item.Item3, TopIResult=value_list)  # -> Result, Log
barnacle_2 = Barnacle()  # -> Result, Log
panel = Panel(barnacle.Log)
